# Grasshopper definition Fibre-Structure-SummerSchool.gh (Grasshopper 1.0.8)
# plug-ins: Robots

divide_curve_count = Slider(12, range=0..100)
radius_1 = Slider(54, range=0..200)
radius_2 = Slider(50, range=0..200)
radius_3 = Slider(113, range=0..200)
height_radius_1 = Slider(0, range=0..200)
height_radius_2 = Slider(35, range=0..200)
height_radius_3 = Slider(200, range=0..200)
distance = Slider(47, range=-100..101)
cir = Circle(Plane=PlaneXY(0, 0, 0), Radius=[radius_1, radius_2, radius_3])
Z = UnitZ(Factor=[height_radius_1, height_radius_2, height_radius_3])
move = Move(Geometry=cir, Motion=Z)  # -> Geometry, Transform
divide = DivideCurve(Curve=move.Geometry, Count=divide_curve_count, Kinks=False)  # -> Points, Tangents, Parameters
pdecon = Deconstruct(Point=divide.Points)  # -> XComponent, YComponent, ZComponent
pt = ConstructPoint(XCoordinate=0, YCoordinate=0, ZCoordinate=pdecon.ZComponent)
vec2pt = Vector2Pt(PointA=divide.Points, PointB=pt, Unitize=False)  # -> Vector, Length
amp = Amplitude(Vector=vec2pt.Vector, Amplitude=distance)
move_2 = Move(Geometry=divide.Points, Motion=amp)  # -> Geometry, Transform
amp_2 = Amplitude(Vector=vec2pt.Vector, Amplitude=Slider(62, range=0..100))
vdis = VectorDisplay(Anchor=divide.Points, Vector=amp_2)
panel = Panel("""false
True""")
panel_2 = Panel("""True
False""")
cull = CullPattern(List=divide.Points, CullPattern=panel)
cull_2 = CullPattern(List=move_2.Geometry, CullPattern=panel_2)
weave = Weave(Pattern=[0, 1], Stream0=cull_2, Stream1=cull, NullGaps=False)
intcrv = Interpolate(Vertices=weave, Degree=Slider(10, range=0..10), Periodic=True, KnotStyle=1)  # -> Curve, Length, Domain
rad = Radians(Degrees=[Slider(0, range=0..360), Slider(0, range=0..360), Slider(0, range=0..360)])
rotate = Rotate(Geometry=flatten(intcrv.Curve), Angle=rad, Plane=PlaneXY(0, 0, 0))  # -> Geometry, Transform
loft = Loft(Curves=rotate.Geometry, Options={Adjust=False, Closed=False, LoftEnds=0, LoftSimp=0, LoftType=0, Rebuild=10, Refit=0.01})
preview = CustomPreview(Geometry=loft, Material=ColourSwatch(SwatchColor=RGB(171, 171, 171)))
contour = Contour(Shape=loft, Point=Point(0, 0, 0), Direction=Vector(0, 0, 1), Distance=Slider(3, range=0..10))
pt_2 = ConstructPoint(XCoordinate=Slider(500, range=0..1000), YCoordinate=Slider(0, range=0..1000), ZCoordinate=Slider(21, range=0..1000))

# ---- group: Load Robot from Library
list = RobotsLibrary(
    {"ETH-Gantry", "iaac-KR150-2_110", "iaac-IRB140", "iaac-IRB120", "RWTH-KR10-R1100", "RWTH-KR210-R3100-ultra", "RWTH-KR270-R2700-ultra", "RWTH-Doosan", "Stuttgart-3xIRB2600", "Stuttgart-IRB4600", "UR3e", "UR5e", "UR10e", "UR16e", "UR3", "UR5", "UR10", "UR20", "UR30"}, selected="UR10",
    Type=0)
load_robot_system = LoadRobotSystem(Name=list, Base=PlaneXY(0, 0, 0))

# ----
orient = Orient(Geometry=contour, Source=PlaneXY(0, 0, 0), Target=pt_2)  # -> Geometry, Transform
preview_2 = CustomPreview(Geometry=orient.Geometry, Material=ColourSwatch(SwatchColor=RGB(255, 0, 0)))

# ---- group: Joint Pose
merge = Merge(
    Data1=Slider(180, range=-360..360),
    Data2=Slider(-60, range=-90..90),
    Data3=Slider(66, range=-160..160),
    Data4=Slider(-7, range=-360..360),
    Data5=Slider(0, range=-360..360),
    Data6=Slider(0, range=-360..360))
degtorad = DegreesToRadians(Degrees=merge, RobotSystem=load_robot_system, MechanicalGroup=0)

# ----
divide_2 = DivideCurve(Curve=orient.Geometry, Count=10, Kinks=False)  # -> Points, Tangents, Parameters
xy = XYPlane(Origin=divide_2.Points)
pt_3 = ConstructPoint(XCoordinate=Slider(500, range=0..1000), YCoordinate=Slider(0, range=0..1000), ZCoordinate=Slider(298, range=0..1000))
xy_2 = XYPlane(Origin=pt_3)
create_target = CreateTarget(Joints=degtorad, IsCartesian=False)
control_knob = ControlKnob(Decimals=2, Limit=True, Maximum=1, Minimum=0, Range=1, Value=0)

# ---- group: Tool - Extruder
radians = Radians(Degrees=Slider(180, range=0..1000))
construct_plane = ConstructPlane(Origin="{83.50,0.00,90.00}", XAxis="{0.00,-1.00,0.00}", YAxis="{0.00,0.00,1.00}")
panel_3 = Panel(construct_plane)
mesh = Mesh(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)

# ----
rotate_2 = Rotate(Geometry=construct_plane, Angle=radians, Plane=PlaneXY(0, 0, 0))  # -> Geometry, Transform

# ---- group: Tool - Extruder (continued)
create_tool = CreateTool(Name="Extruder", TCP=rotate_2.Geometry, Weight=0, Mesh=mesh)  # -> Tool, TCP

# ----
create_target_2 = CreateTarget(Plane=xy, Tool=create_tool.Tool, IsCartesian=True)
create_target_3 = CreateTarget(Plane=xy_2, Tool=create_tool.Tool, IsCartesian=True)
merge_2 = Merge(Data1=flatten(create_target_3), Data2=flatten(create_target_2), Data5=flatten(create_target_3))
create_program = CreateProgram(Name="InnoTech_Print_250122", RobotSystem=load_robot_system, Targets=merge_2, StepSize=1)  # -> Program, Code, Duration, Warnings, Errors
panel_4 = Panel(create_program.Warnings)
panel_5 = Panel(create_program.Errors)
panel_6 = Panel(create_program.Code)
program_simulation = ProgramSimulation(Program=create_program.Program, Time=control_knob, Normalized=True)  # -> SystemMeshes, JointRotations, Plane, Index, Time, Program, Errors
replace_text = ReplaceText(Text=create_program.Code, Find="a=57295.77951", Replace="a=180", RecursiveReplace=False)
custom_preview = CustomPreview(Geometry=program_simulation.SystemMeshes, Material=ColourSwatch(SwatchColor=RGB(113, 148, 209)))
data_dam = DataDam(DataDataA=replace_text, BufferDelay=10000000, BufferMode=0)
panel_7 = Panel(replace_text)
save_program = SaveProgram(Program=data_dam, Folder="C:\Users\hbenz\Desktop\ITiC")
