# Grasshopper definition Fibre-Structure-SummerSchool_v3_Non-Planar-Non-Collapse.gh (Grasshopper 1.0.8)
# plug-ins: Robots

point = Point(<point referenced from the Rhino model>)
yz_plane = YZPlane(Origin=point)
curve = Curve(<curve referenced from the Rhino model>)
mirror = Mirror(Geometry=curve, Plane=yz_plane)  # -> Geometry, Transform

# ---- group: Heigth
number_slider = Slider(30, range=0..100)
number_slider_2 = Slider(102, range=0..1000)
number_slider_3 = Slider(120, range=0..1000)

# ---- group: Scale
number_slider_4 = Slider(0.9, range=0..2)
number_slider_5 = Slider(1.6, range=0..2)
number_slider_6 = Slider(1.9, range=0..2)

# ---- group: Rotation
number_slider_7 = Slider(-6, range=-20..20)
number_slider_8 = Slider(12, range=-20..20)
number_slider_9 = Slider(20, range=-20..20)

# ----
polar_array = PolarArray(Geometry=[curve, mirror.Geometry], Plane=point, Count=Slider(6, range=0..10), Angle=6.283185307)  # -> Geometry, Transform
join_curves = JoinCurves(Curves=flatten(polar_array.Geometry), Preserve=False)
unit_z = UnitZ(Factor=number_slider_2)
unit_z_2 = UnitZ(Factor=number_slider_3)
unit_z_3 = UnitZ(Factor=number_slider)
move = Move(Geometry=join_curves, Motion=unit_z)  # -> Geometry, Transform
move_2 = Move(Geometry=join_curves, Motion=unit_z_2)  # -> Geometry, Transform
move_3 = Move(Geometry=join_curves, Motion=unit_z_3)  # -> Geometry, Transform
area = Area(Geometry=move_3.Geometry)  # -> Area, Centroid
area_2 = Area(Geometry=move.Geometry)  # -> Area, Centroid
area_3 = Area(Geometry=move_2.Geometry)  # -> Area, Centroid
scale = Scale(Geometry=move.Geometry, Center=area_2.Centroid, Factor=number_slider_5)  # -> Geometry, Transform
scale_2 = Scale(Geometry=move_2.Geometry, Center=area_3.Centroid, Factor=number_slider_6)  # -> Geometry, Transform
radians = Radians(Degrees=number_slider_8)
scale_3 = Scale(Geometry=move_3.Geometry, Center=area.Centroid, Factor=number_slider_4)  # -> Geometry, Transform
radians_2 = Radians(Degrees=number_slider_9)
radians_3 = Radians(Degrees=number_slider_7)
divide_curve_count = Slider(20, range=0..100)  # disabled
radius_1 = Slider(42, range=0..200)  # disabled
radius_2 = Slider(46, range=0..200)  # disabled
height_radius_1 = Slider(0, range=0..200)  # disabled
distance = Slider(50, range=-100..101)  # disabled
radius_3 = Slider(113, range=0..200)  # disabled
height_radius_2 = Slider(111, range=0..200)  # disabled
height_radius_3 = Slider(200, range=0..200)  # disabled
number_slider_10 = Slider(10, range=0..10)  # disabled
number_slider_11 = Slider(0, range=0..360)  # disabled
number_slider_12 = Slider(0, range=0..360)  # disabled
number_slider_13 = Slider(0, range=0..360)  # disabled
rotate = Rotate(Geometry=scale.Geometry, Angle=radians, Plane=area_2.Centroid)  # -> Geometry, Transform
rotate_2 = Rotate(Geometry=scale_2.Geometry, Angle=radians_2, Plane=area_3.Centroid)  # -> Geometry, Transform
rotate_3 = Rotate(Geometry=scale_3.Geometry, Angle=radians_3, Plane=area.Centroid)  # -> Geometry, Transform
curve_2 = Curve([<curve referenced from the Rhino model> x101])
curve_3 = Curve([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])
panel = Panel("""true
false""")
curve_4 = Curve([<curve referenced from the Rhino model> x183])
circle = Circle(Plane=PlaneXY(0, 0, 0), Radius=[radius_1, radius_2, radius_3])  # disabled
merge = Merge(Data1=join_curves, Data2=rotate_3.Geometry, Data3=rotate.Geometry, Data4=rotate_2.Geometry)
unit_z_4 = UnitZ(Factor=[height_radius_1, height_radius_2, height_radius_3])  # disabled
cull_pattern = CullPattern(List=curve_3, CullPattern=panel)
loft = Loft(Curves=merge, Options={Adjust=False, Closed=False, LoftEnds=0, LoftSimp=0, LoftType=0, Rebuild=10, Refit=0.01})
move_4 = Move(Geometry=circle, Motion=unit_z_4)  # -> Geometry, Transform; disabled
reverse_list = ReverseList(List=cull_pattern)
divide_curve = DivideCurve(Curve=move_4.Geometry, Count=divide_curve_count, Kinks=False)  # -> Points, Tangents, Parameters; disabled
custom_preview = CustomPreview(Geometry=loft, Material=ColourSwatch(SwatchColor=RGB(255, 255, 255)))
panel_2 = Panel(curve_3)
deconstruct = Deconstruct(Point=divide_curve.Points)  # -> XComponent, YComponent, ZComponent; disabled
construct_point = ConstructPoint(XCoordinate=0, YCoordinate=0, ZCoordinate=deconstruct.ZComponent)  # disabled
group = Group(Geometry=curve_3)
number_slider_14 = Slider(62, range=0..100)  # disabled
vector_2pt = Vector2Pt(PointA=divide_curve.Points, PointB=construct_point, Unitize=False)  # -> Vector, Length; disabled
amplitude = Amplitude(Vector=vector_2pt.Vector, Amplitude=distance)  # disabled
bounding_box = BoundingBox(Content=group, Plane=PlaneXY(0, 0, 0))  # -> Box, Box_2
move_5 = Move(Geometry=divide_curve.Points, Motion=amplitude)  # -> Geometry, Transform; disabled
amplitude_2 = Amplitude(Vector=vector_2pt.Vector, Amplitude=number_slider_14)  # disabled
volume = Volume(Geometry=bounding_box.Box)  # -> Volume, Centroid
vector_display = VectorDisplay(Anchor=divide_curve.Points, Vector=amplitude_2)  # disabled
panel_3 = Panel("""false
True""")  # disabled
panel_4 = Panel("""True
False""")  # disabled
deconstruct_2 = Deconstruct(Point=volume.Centroid)  # -> XComponent, YComponent, ZComponent
cull_pattern_2 = CullPattern(List=divide_curve.Points, CullPattern=panel_3)  # disabled
cull_pattern_3 = CullPattern(List=move_5.Geometry, CullPattern=panel_4)  # disabled
construct_point_2 = ConstructPoint(XCoordinate=deconstruct_2.XComponent, YCoordinate=deconstruct_2.YComponent, ZCoordinate=0)
weave = Weave(Pattern=[0, 1], Stream0=cull_pattern_3, Stream1=cull_pattern_2, NullGaps=False)  # disabled
interpolate = Interpolate(Vertices=weave, Degree=number_slider_10, Periodic=True, KnotStyle=1)  # -> Curve, Length, Domain; disabled
radians_4 = Radians(Degrees=[number_slider_11, number_slider_12, number_slider_13])  # disabled
rotate_4 = Rotate(Geometry=flatten(interpolate.Curve), Angle=radians_4, Plane=PlaneXY(0, 0, 0))  # -> Geometry, Transform; disabled

construct_point_3 = ConstructPoint(XCoordinate=Slider(0, range=0..1000), YCoordinate=Slider(-600, range=-700..0), ZCoordinate=Slider(-56, range=-58..0))

colour_swatch = ColourSwatch(SwatchColor=RGB(171, 171, 171))  # disabled
loft_2 = Loft(
    Curves=rotate_4.Geometry,
    Options={Adjust=False, Closed=False, LoftEnds=0, LoftSimp=0, LoftType=0, Rebuild=10, Refit=0.01})  # disabled
custom_preview_2 = CustomPreview(Geometry=loft_2, Material=colour_swatch)  # disabled
orient = Orient(Geometry=curve_3, Source=construct_point_2, Target=construct_point_3)  # -> Geometry, Transform
list_length = ListLength(List=orient.Geometry)
panel_5 = Panel(list_length)
construct_domain = ConstructDomain(DomainStart=Slider(81, range=0..100), DomainEnd=Slider(100, range=0..1000))
sub_list = SubList(List=orient.Geometry, Domain=construct_domain, Wrap=True)  # -> List, Index
panel_6 = Panel("-42")
trim_tree = TrimTree(Tree=sub_list.List, Depth=1)

# ---- group: Load Robot from Library
robots_library = RobotsLibrary(
    {"ETH-Gantry", "iaac-KR150-2_110", "iaac-IRB140", "iaac-IRB120", "RWTH-KR10-R1100", "RWTH-KR210-R3100-ultra", "RWTH-KR270-R2700-ultra", "RWTH-Doosan", "Stuttgart-3xIRB2600", "Stuttgart-IRB4600", "UR3e", "UR5e", "UR10e", "UR16e", "UR3", "UR5", "UR10", "UR20", "UR30"}, selected="UR10",
    Type=0)
load_robot_system = LoadRobotSystem(Name=robots_library, Base=PlaneXY(0, 0, 0))

# ----
divide_distance = DivideDistance(Curve=trim_tree, Distance=Slider(5, range=0..10))  # -> Points, Tangents, Parameters
list_length_2 = ListLength(List=flatten(divide_distance.Points))
panel_7 = Panel(list_length_2)
perp_frame = PerpFrame(Curve=graft(sub_list.List), Parameter=divide_distance.Parameters)
simplify_tree = SimplifyTree(Tree=divide_distance.Points, Front=False)
deconstruct_plane = DeconstructPlane(Plane=perp_frame)  # -> Origin, XAxis, YAxis, ZAxis
construct_point_4 = ConstructPoint(XCoordinate=Slider(0, range=0..1000), YCoordinate=Slider(-600, range=-700..0), ZCoordinate=Slider(250, range=0..1000))
plane_normal = PlaneNormal(Origin=simplify_tree, ZAxis=deconstruct_plane.YAxis)
number_slider_15 = Slider(0.5, range=0..1)
number_slider_16 = Slider(45, range=0..100)
number_slider_17 = Slider(2, range=0..10)
xy_plane = XYPlane(Origin=construct_point_4)
deconstruct_plane_2 = DeconstructPlane(Plane=xy_plane)  # -> Origin, XAxis, YAxis, ZAxis
set_do = SetDO(DO="0", Value="1")
set_do_2 = SetDO(DO="0", Value="0")
align_plane = AlignPlane(Plane=plane_normal, Direction=deconstruct_plane_2.XAxis)  # -> Plane, Angle
list = FlagFields({"Shoulder": 1, "Elbow": 2, "Wrist": 4}, selected="Wrist")
list_2 = ValueList({"Joint", "Linear"}, selected="Joint")
list_3 = ValueList({"Joint", "Linear"}, selected="Linear")
list_item = ListItem(List=flatten(align_plane.Plane), Index="-1", Wrap=True)
list_4 = ValueList({"Joint", "Linear"}, selected="Linear")

# ---- group: Joint Pose
merge_2 = Merge(
    Data1=Slider(70, range=-360..360),
    Data2=Slider(-60, range=-90..90),
    Data3=Slider(120, range=-160..160),
    Data4=Slider(-60, range=-360..360),
    Data5=Slider(20, range=-360..360),
    Data6=Slider(0, range=-360..360))
degrees_to_radians = DegreesToRadians(Degrees=merge_2, RobotSystem=load_robot_system, MechanicalGroup=0)

# ----
control_knob = ControlKnob(Decimals=2, Limit=True, Maximum=1, Minimum=0, Range=1, Value=0)

# ---- group: Tool - Extruder
construct_point_5 = ConstructPoint(XCoordinate="-168", YCoordinate="0", ZCoordinate="57")
radians_5 = Radians(Degrees=Slider(174, range=0..1000))
plane_normal_2 = PlaneNormal(Origin=construct_point_5, ZAxis="{1,0,0}")
mesh = Mesh(<mesh referenced from the Rhino model>)
mesh_2 = Mesh(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)

# ----
rotate_plane = RotatePlane(Plane=plane_normal_2, Angle=radians_5)

# ---- group: Tool - Extruder (continued)
create_tool = CreateTool(Name="Extruder", TCP=rotate_plane, Weight="1", Mesh=mesh)  # -> Tool, TCP

# ----
create_target = CreateTarget(
    Plane=xy_plane,
    RobConf=list,
    Motion=list_2,
    Tool=create_tool.Tool,
    Speed=number_slider_16,
    Zone=number_slider_17,
    Command=set_do_2,
    IsCartesian=True)
create_target_2 = CreateTarget(
    Plane=align_plane.Plane,
    Motion=list_3,
    Tool=create_tool.Tool,
    Speed=number_slider_16,
    Zone=number_slider_17,
    Command=set_do,
    IsCartesian=True)
create_target_3 = CreateTarget(
    Plane=list_item,
    Motion=list_4,
    Tool=create_tool.Tool,
    Speed=number_slider_16,
    Zone=number_slider_17,
    Command=set_do_2,
    IsCartesian=True)
merge_3 = Merge(
    Data1=flatten(create_target),
    Data2=flatten(create_target_2),
    Data3=flatten(create_target_3),
    Data5=flatten(create_target))
create_program = CreateProgram(Name="Testv1", RobotSystem=load_robot_system, Targets=merge_3, StepSize=1)  # -> Program, Code, Duration, Warnings, Errors
data_dam = DataDam(DataA=create_program.Program, BufferDelay=10000000, BufferMode=0)
panel_8 = Panel(create_program.Warnings)
panel_9 = Panel(create_program.Errors)
remote_connection = RemoteConnection(Program=data_dam, IP="10.1.0.125", Upload=Button(), Play=Button(), Pause=Button())
panel_10 = Panel(remote_connection)
program_simulation = ProgramSimulation(Program=create_program.Program, Time=control_knob, Normalized=True)  # -> SystemMeshes, JointRotations, Plane, Index, Time, Program, Errors
simple_trail = SimpleTrail(Program=program_simulation.Program, Length=500, MechanicalGroup=0)
custom_preview_3 = CustomPreview(Geometry=program_simulation.SystemMeshes, Material=ColourSwatch(SwatchColor=RGB(113, 148, 209)))
data_dam_2 = DataDam(DataDataA=program_simulation.Program, BufferDelay=10000000, BufferMode=0)
save_program = SaveProgram(Program=data_dam_2, Folder="C:\Users\hbenz\Desktop\BTU")
