# Grasshopper definition Spiralizer.gh (Grasshopper 1.0.8)

divide = DivideCurve(Count=10, Kinks=False)  # -> Points, Tangents, Parameters
spiralizer = Spiralizer(T=divide.Points)
flatten = FlattenTree(Tree=spiralizer, Path="{0}")
pline = PolyLine(Vertices=spiralizer, Closed=False)
geo = Geometry(pline)
pt = Point(flatten)

# ==== cluster Spiralizer
T = ClusterInput()
simplify = SimplifyTree(Tree=T, Front=False)
tstat = TreeStatistics(Tree=simplify)  # -> Paths, Length, Count
tstat_2 = TreeStatistics(Tree=simplify)  # -> Paths, Length, Count
cull_i = CullIndex(List=tstat.Paths, Indices="-1", Wrap=True)
cull_i_2 = CullIndex(List=tstat_2.Paths, Indices="0", Wrap=True)
branch = TreeBranch(Tree=simplify, Path=cull_i_2, MaintainPaths=True)
branch_2 = TreeBranch(Tree=simplify, Path=cull_i, MaintainPaths=True)
path_mapper = PathMapper(branch, source="{A}", target="{A-1}")
vec2pt = Vector2Pt(PointA=branch_2, PointB=path_mapper, Unitize=False)  # -> Vector, Length
tstat_3 = TreeStatistics(Tree=branch_2)  # -> Paths, Length, Count
range = Range(Domain=Domain(0, 1), Steps=expr("x-1", tstat_3.Length))  # -> simplify(Range)
multiplication = Multiplication(A=vec2pt.Length, B=range)
panel = Panel(range)
amp = Amplitude(Vector=vec2pt.Vector, Amplitude=multiplication)
move = Move(Geometry=branch_2, Motion=simplify(amp))  # -> Geometry, Transform
G = ClusterOutput(move.Geometry)
